# Grasshopper definition generative.gh (Grasshopper 1.0.7)
# plug-ins: jSwan

vec = VectorXYZ(XComponent=0, YComponent=0, ZComponent=0)  # -> Vector, Length
number_slider = Slider(1, range=0..10)
number_slider_2 = Slider(1, range=0..10)
crv = Curve(<curve referenced from the Rhino model>)
pt = Point(vec.Vector)
divdist = DivideDistance(Curve=crv, Distance=number_slider_2)  # -> Points, Tangents, Parameters
crv_2 = Curve(<curve referenced from the Rhino model>)
crv_3 = Curve(<curve referenced from the Rhino model>)
crv_4 = Curve([<curve referenced from the Rhino model> x3])
geo = Geometry(flatten([pt, divdist.Points]))
divdist_2 = DivideDistance(Curve=crv_2, Distance=number_slider)  # -> flatten(Points), Tangents, Parameters
divdist_3 = DivideDistance(Curve=crv_3, Distance=number_slider)  # -> flatten(Points), Tangents, Parameters
divdist_4 = DivideDistance(Curve=crv_4, Distance=number_slider)  # -> flatten(Points), Tangents, Parameters
pline = PolyLine(Vertices=geo, Closed=True)
addition = Addition(A="4980", B=Slider(6, range=0..20))
geo_2 = Geometry(<curve referenced from the Rhino model>)
offset = OffsetCurve(Curve=pline, Distance=1, Plane=PlaneXY(0, 0, 0), Corners=1)
divdist_5 = DivideDistance(Curve=geo_2, Distance=number_slider_2)  # -> Points, Tangents, Parameters
item = ListItem(List=divdist_4.Points, Index=addition, Wrap=True)
rec_2pt = Rectangle2Pt(Plane=PlaneXY(0, 0, 0), PointA=Point(0, 0, 0), PointB=Point(10, 5, 0), Radius=0)  # -> Rectangle, Length
divdist_6 = DivideDistance(Curve=flatten(offset), Distance=number_slider_2)  # -> Points, Tangents, Parameters
merge = Merge(Data1=divdist_6.Points, Data2=divdist_5.Points)
rejson = SerializeJson(PreJitter=divdist_4.Points, Perimeter=divdist_3.Points, PostJitter=divdist_2.Points, IncludeNullAndEmptyProperties=False)
rejson_2 = SerializeJson(Interior=merge, Perimeter=flatten(geo), IncludeNullAndEmptyProperties=False)
item_2 = ListItem(List=merge, Index=Slider(5, range=0..10), Wrap=True)
panel = Panel(rejson)
